# Grasshopper definition origiami.gh (Grasshopper 1.0.8)
# plug-ins: Bifocals

pt = ConstructPoint(XCoordinate=0, YCoordinate=0, ZCoordinate=0)
pt_2 = ConstructPoint(XCoordinate=0, YCoordinate=Slider(26, range=0..100), ZCoordinate=0)
ln = Line(StartPoint=pt, EndPoint=pt_2)
pi = Pi(Factor=Slider(0.6, range=0..1))
divide = DivideCurve(Curve=ln, Count=Slider(51, range=11..51), Kinks=False)  # -> Points, Tangents, Parameters
sin = Sine(Value=pi)
cos = Cosine(Value=pi)
dispatch = Dispatch(List=divide.Points, DispatchPattern=[True, False])  # -> ListA, ListB
vec = VectorXYZ(XComponent=sin, YComponent=cos, ZComponent=0)  # -> Vector, Length
amp = Amplitude(Vector=vec.Vector, Amplitude=Slider(0.8, range=0..1))
move = Move(Geometry=dispatch.ListB, Motion=amp)  # -> Geometry, Transform
merge = Merge(Data1=graft(dispatch.ListA), Data2=graft(move.Geometry))
pt_3 = Point(flatten(merge))
X = UnitX(Factor=Slider(0.7, range=0.5..3))
pline = PolyLine(Vertices=pt_3, Closed=False)
arrlinear = LinearArray(Geometry=pline, Direction=X, Count=Slider(39, range=1..40))  # -> Geometry, Transform
Z = UnitZ(Factor=Slider(2.1, range=0.5..3))
dispatch_2 = Dispatch(List=arrlinear.Geometry, DispatchPattern=[True, False])  # -> ListA, ListB
move_2 = Move(Geometry=dispatch_2.ListB, Motion=Z)  # -> Geometry, Transform
crv = Curve(dispatch_2.ListA)
merge_2 = Merge(Data1=graft(crv), Data2=graft(move_2.Geometry))  # -> flatten(Result)
crv_2 = Curve(simplify(merge_2))
shift = ShiftList(List=crv_2, Shift=1, Wrap=invert(True))
crv_3 = Curve(flatten(merge_2))
disc = Discontinuity(Curve=shift, Level=1)  # -> Points, Parameters
disc_2 = Discontinuity(Curve=crv_2, Level=1)  # -> Points, Parameters
shift_2 = ShiftList(List=crv_3, Shift=1, Wrap=invert(True))
shift_3 = ShiftList(List=disc_2.Points, Shift=1, Wrap=invert(True))
shift_4 = ShiftList(List=disc.Points, Shift=1, Wrap=invert(True))
rulesrf = RuledSurface(CurveA=crv_3, CurveB=shift_2)
srf4pt = _4PointSurface(CornerA=disc_2.Points, CornerB=shift_3, CornerC=shift_4, CornerD=disc.Points)
