# Grasshopper definition waffle.gh (Grasshopper 1.0.8)
# plug-ins: Pufferfish, Bifocals

number_slider = Slider(100, range=0..100)
rectangle = Rectangle(Plane=PlaneXY(0, 0, 0), XSize=number_slider, YSize=number_slider, Radius=0)  # -> Rectangle, Length
debrep = DeconstructBrep(Brep=rectangle.Rectangle)  # -> Faces, Edges, Vertices
number_slider_2 = Slider(15, range=0..100)
number_slider_3 = Slider(100, range=0..100)
srf = Surface(rectangle.Rectangle)
item = ListItem(List=debrep.Edges, Index=0, Wrap=True)  # -> Item, Item1
sdivide = DivideSurface(Surface=srf, UCount=number_slider_3, VCount=number_slider_3)  # -> flatten(Points), Normals, Parameters
pt = Point(<point referenced from the Rhino model>)
pframes = PerpFrames(Curve=item.Item1, Count=number_slider_2, Align=True)  # -> Frames, Parameters
pframes_2 = PerpFrames(Curve=item.Item, Count=number_slider_2, Align=True)  # -> Frames, Parameters
pi = Pi(Factor=Slider(9, range=0..10))
lng = ListLength(List=pframes_2.Frames)
dist = Distance(PointA=pt, PointB=sdivide.Points)
lng_2 = ListLength(List=pframes.Frames)
dom = ConstructDomain(DomainStart=0, DomainEnd=pi)
bnd = Bounds(Numbers=dist)
repeat = RepeatData(Data=Slider(1, range=0..1), Length=lng)
repeat_2 = RepeatData(Data=Slider(1, range=0..1), Length=lng_2)
remap = RemapNumbers(Value=dist, Source=bnd, Target=dom)  # -> Mapped, Clipped
lastdex = LastIndex(List=repeat)
lastdex_2 = LastIndex(List=repeat_2)
sin = Sine(Value=remap.Mapped)
replace = ReplaceItems(List=repeat, Item=Slider(-1, range=-1..0), Indices=lastdex, Wrap=False)
replace_2 = ReplaceItems(List=repeat_2, Item=Slider(-1, range=-1..0), Indices=lastdex_2, Wrap=False)
multiplication = Multiplication(A=sin, B=Slider(3, range=0..10))
X = UnitX(Factor=replace)
Z = UnitZ(Factor=multiplication)
Y = UnitY(Factor=replace_2)
move = Move(Geometry=pframes_2.Frames, Motion=X)  # -> Geometry, Transform
move_2 = Move(Geometry=sdivide.Points, Motion=Z)  # -> Geometry, Transform
move_3 = Move(Geometry=pframes.Frames, Motion=Y)  # -> Geometry, Transform
int = Integer(number_slider_3)
merge = Merge(Data1=pframes_2.Frames, Data2=move.Geometry)  # -> flatten(Result)
merge_2 = Merge(Data1=pframes.Frames, Data2=move_3.Geometry)  # -> flatten(Result)
addition = Addition(A=int, B=Slider(1, range=0..1))
sort = SortList(Keys=merge, ValuesA=merge)  # -> Keys, ValuesA
sort_2 = SortList(Keys=merge_2, ValuesA=merge_2)  # -> Keys, ValuesA
srfgrid = SurfaceFromPoints(Points=move_2.Geometry, UCount=addition, Interpolate=False)
entwine = Entwine(Branch00=sort.ValuesA, Branch01=sort_2.ValuesA, FlattenInputs=True)
sec = BrepPlane(Brep=srfgrid, Plane=entwine)  # -> Curves, Points
pshift = ShiftPaths(Data=sec.Curves, Offset=-1)
move_4 = Move(Geometry=pshift, Motion=Vector(0, 0, 10))  # -> Geometry, Transform
project = Project(Geometry=move_4.Geometry, Plane=PlaneXY(0, 0, 0))  # -> Geometry, Transform
rulesrf = RuledSurface(CurveA=move_4.Geometry, CurveB=project.Geometry)
partition = PartitionList(List=rulesrf, Size=Slider(2, range=0..10))
item_2 = ListItem(List=partition, Index=0, Wrap=True)  # -> Item, Item1
rulesrf_2 = RuledSurface(CurveA=item_2.Item, CurveB=item_2.Item1)
merge_3 = Merge(Data1=rulesrf, Data2=rulesrf_2)
